# Grasshopper definition udp_receiver_from_hand_tracking.gh (Grasshopper 1.0.7)
# plug-ins: gHowl, Robots

# ---- group: Distance to camera
udp = UDPReceiver(Address="127.0.0.1", Port="3052", Pattern=0)  # -> Info, Data
panel = Panel(udp.Info)
panel_2 = Panel(udp.Data)
round = Round(Number=panel_2)  # -> Nearest, Floor, Ceiling

# ----
udp_2 = UDPReceiver(Address="127.0.0.1", Port="5052", Pattern=0)  # -> Info, Data
panel_3 = Panel(udp_2.Info)
fragment = TextFragment(Text=udp_2.Data, Start="1")
len = TextLength(Text=fragment)
subtraction = Subtraction(A=len, B="1")
fragment_2 = TextFragment(Text=fragment, Start="0", Count=subtraction)
rep = ReplaceText(Text=fragment_2, Find=" ", RecursiveReplace=False)
split = TextSplit(Text=rep, Separators=",")
data = Data(["719", "183", "0", "650", "207", "-21", "592", "249", "-39", "544"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])
partition = PartitionList(List=split, Size=3)
panel_4 = Panel(split)
rep_2 = ReplaceText(Text=partition, Find="[", RecursiveReplace=False)
rep_3 = ReplaceText(Text=rep_2, Find="]", RecursiveReplace=False)
item = ListItem(List=rep_3, Index=0, Wrap=True)  # -> Item, Item1, Item2
Z = UnitZ(Factor=1)
pt = ConstructPoint(XCoordinate=item.Item, YCoordinate=item.Item1, ZCoordinate=item.Item2)
X = UnitX(Factor=1)
rot3d = Rotate3D(Geometry=pt, Angle=1.570796327, Center=Point(0, 0, 0), Axis=X)  # -> Geometry, Transform
xz = XZPlane(Origin=Point(0, 0, 0))
X_2 = UnitX(Factor=Slider(695, range=0..1000))
mirror = Mirror(Geometry=rot3d.Geometry, Plane=xz)  # -> Geometry, Transform
neg = Negative(Value=X_2)
Z_2 = UnitZ(Factor=Slider(0, range=0..1000))

pt_2 = Point(Point(171.7250675, 0, 70.44479411))
brep = Brep([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])
yz = YZPlane(Origin=pt_2)
mesh = MeshBrep(
    Brep=brep,
    Settings={GridMaxCount=0, GridMinCount=16, JaggedSeams=False, MaxEdgeLength=0, MinEdgeLength=0.0001, MinTolerance=0, Refine=True, RefineAngle=0, RelativeTolerance=0.65, SimplePlanes=True, Tolerance=0})
mjoin = MeshJoin(Meshes=mesh)
tool = CreateTool(Name="DefaultGHTool", TCP=yz, Weight=0, Mesh=mjoin)  # -> Tool, TCP

pt_3 = Point(Point(-978.2865764, -158.7775268, 299.6980235))
xy = XYPlane(Origin=yz)
pl = ConstructPlane(Origin=pt_3, XAxis=expr("-X", Vector(1, 0, 0)), YAxis=Vector(0, 1, 0))

target = CreateTarget(Joints="pi/2,pi/2,0,0,pi/2,0", Tool=tool.Tool, IsCartesian=False)
target_2 = CreateTarget(Joints="pi/2,0,0,0,pi/2,pi/2", Tool=tool.Tool, IsCartesian=False)
merge = Merge(Data1=target_2, Data2=target)

list = RobotsLibrary(
    {"Bartlett-IRB120", "Bartlett-IRB1600", "Bartlett-UR10", "Bartlett-KR6", "Bartlett-KR60", "Bartlett-KR60x2", "Bartlett-KR60+DKP400", "Bartlett-KR60__DKP400_0", "Bartlett-KR60+DKP400-A", "Bartlett-KR60+DKP400-B", "Bartlett-KR60+KL-1000", "Bartlett-KR500", "Bartlett-RX160", "Bartlett-RX160L", "Bartlett-TX200", "Bartlett-TX200L", "UR3e", "UR5e", "UR10e", "UR16e", "UR3", "UR5", "UR10"}, selected="UR10",
    Type=0)
pt_4 = ConstructPoint(
    XCoordinate=Slider(-332, range=-1000..1001),
    YCoordinate=Slider(-1000, range=-1000..1001),
    ZCoordinate=Slider(0, range=-1000..1001))
load_robot = LoadRobotSystem(Name=list, Base=pt_4)

# ---- group: Refine the position of the hand in relation to origin
Y = UnitY(Factor=round.Nearest)
neg_2 = Negative(Value=Y)
Z_3 = UnitZ(Factor=Slider(0, range=0..1000))
multiplication = Multiplication(A=neg_2, B=Slider(2, range=0..100))

# ----
addition = Addition(A=multiplication, B=neg)

# ---- group: Refine the position of the hand in relation to origin (continued)
move = Move(Geometry=mirror.Geometry, Motion=addition)  # -> Geometry, Transform
move_2 = Move(Geometry=move.Geometry, Motion=Z_3)  # -> Geometry, Transform

# ----
panel_5 = Panel(multiplication)

# ---- group: Finger to follow
item_2 = ListItem(List=flatten(move.Geometry), Index=Slider(8, range=0..100), Wrap=True)

# ----
move_3 = Move(Geometry=item_2, Motion=Z_2)  # -> Geometry, Transform

# ---- group: Robotic target input
pt_5 = Point(move_3.Geometry)

# ---- group: Hand
cluster = Cluster(
    L=move_2.Geometry,
    L_2=move_2.Geometry,
    L_3=move_2.Geometry,
    L_4=move_2.Geometry,
    L_5=move_2.Geometry,
    L_6=move_2.Geometry,
    L_7=move_2.Geometry,
    L_8=move_2.Geometry,
    L_9=move_2.Geometry,
    L_10=move_2.Geometry,
    L_11=move_2.Geometry,
    L_12=move_2.Geometry,
    L_13=move_2.Geometry,
    L_14=move_2.Geometry,
    L_15=move_2.Geometry,
    L_16=move_2.Geometry,
    L_17=move_2.Geometry,
    L_18=move_2.Geometry,
    L_19=move_2.Geometry,
    L_20=move_2.Geometry,
    L_21=move_2.Geometry,
    L_22=move_2.Geometry,
    L_23=move_2.Geometry,
    L_24=move_2.Geometry,
    L_25=move_2.Geometry)  # -> i, i_2, i_3, i_4, i_5, i_6, i_7, i_8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
ln = Line(StartPoint=cluster.i_23, EndPoint=cluster.i_21)
ln_2 = Line(StartPoint=cluster.i_12, EndPoint=cluster.i_15)
ln_3 = Line(StartPoint=cluster.i_21, EndPoint=cluster.i_19)
ln_4 = Line(StartPoint=cluster.i_14, EndPoint=cluster.i_13)
ln_5 = Line(StartPoint=cluster.i_13, EndPoint=cluster.i_11)
ln_6 = Line(StartPoint=cluster.i_9, EndPoint=cluster.i_16)
ln_7 = Line(StartPoint=cluster.i_16, EndPoint=cluster.i_14)
ln_8 = Line(StartPoint=cluster.i_10, EndPoint=cluster.i_12)
ln_9 = Line(StartPoint=cluster.i_17, EndPoint=cluster.i_16)
ln_10 = Line(StartPoint=cluster.i_15, EndPoint=cluster.i_18)
ln_11 = Line(StartPoint=cluster.i, EndPoint=cluster.i_24)
ln_12 = Line(StartPoint=cluster.i_7, EndPoint=cluster.i_23)
ln_13 = Line(StartPoint=cluster.i_9, EndPoint=cluster.i_10)
ln_14 = Line(StartPoint=cluster.i_5, EndPoint=cluster.i_3)
ln_15 = Line(StartPoint=cluster.i_22, EndPoint=cluster.i_8)
ln_16 = Line(StartPoint=cluster.i_20, EndPoint=cluster.i_22)
ln_17 = Line(StartPoint=cluster.i_24, EndPoint=cluster.i_25)
ln_18 = Line(StartPoint=cluster.i_8, EndPoint=cluster.i_5)
ln_19 = Line(StartPoint=cluster.i_2, EndPoint=cluster.i_4)
ln_20 = Line(StartPoint=cluster.i_6, EndPoint=cluster.i_7)
ln_21 = Line(StartPoint=cluster.i_25, EndPoint=cluster.i_2)

# ----
rec = DataRecorder(pt_5, DataLimit=-10, RecordData=False)
pt_6 = Point(pt_5)
intcrv = Interpolate(Vertices=rec, Degree=3, Periodic=False, KnotStyle=1)  # -> Curve, Length, Domain
panel_6 = Panel(move_3.Geometry)
pl_2 = ConstructPlane(Origin=pt_6, XAxis=expr("-X", Vector(1, 0, 0)), YAxis=Vector(0, 1, 0))
panel_7 = Panel(pl_2)

list_2 = ValueList({"Joint", "Linear"}, selected="Joint")
list_3 = ValueList({"Joint", "Linear"}, selected="Linear")
target_3 = CreateTarget(Plane=pl, Motion=list_2, Tool=tool.Tool, IsCartesian=True)
target_4 = CreateTarget(Plane=pl_2, Motion=list_3, Tool=tool.Tool, IsCartesian=True)
merge_2 = Merge(Data1=target_3, Data2=target_4)

list_4 = ValueList({"Joint", "Linear"}, selected="Joint")
list_5 = ValueList({"Joint", "Linear"}, selected="Joint")
target_5 = CreateTarget(Plane=pl_2, Motion=list_4, Tool=tool.Tool, IsCartesian=True)
target_6 = CreateTarget(Plane=pl, Motion=list_5, Tool=tool.Tool, IsCartesian=True)
merge_3 = Merge(Data1=target_6, Data2=target_5)

filter = StreamFilter(Gate=Slider(1, range=0..2), Stream0=merge, Stream1=merge_3, Stream2=merge_2)
program = CreateProgram(Name="DefaultProgram", RobotSystem=load_robot, Targets=flatten(filter), StepSize=Slider(0.5, range=0..1))  # -> Program, Code, Duration, Warnings, Errors
panel_8 = Panel(program.Errors)
sim = ProgramSimulation(Program=program.Program, Time=Slider(1, range=0..1), Normalized=True)  # -> SystemMeshes, JointRotations, Plane, Index, Time, Program, Errors
trail = SimpleTrail(Program=sim.Program, Length=3000, MechanicalGroup=0)
mesh_2 = Mesh(sim.SystemMeshes)
item_3 = ListItem(List=mesh_2, Index=0, Wrap=True)

# ==== cluster Cluster
L = ClusterInput()
L_2 = ClusterInput()
L_3 = ClusterInput()
L_4 = ClusterInput()
L_5 = ClusterInput()
L_6 = ClusterInput()
L_7 = ClusterInput()
L_8 = ClusterInput()
L_9 = ClusterInput()
L_10 = ClusterInput()
L_11 = ClusterInput()
L_12 = ClusterInput()
L_13 = ClusterInput()
L_14 = ClusterInput()
L_15 = ClusterInput()
L_16 = ClusterInput()
L_17 = ClusterInput()
L_18 = ClusterInput()
L_19 = ClusterInput()
L_20 = ClusterInput()
L_21 = ClusterInput()
L_22 = ClusterInput()
L_23 = ClusterInput()
L_24 = ClusterInput()
L_25 = ClusterInput()
item = ListItem(List=flatten(L), Index=Slider(5, range=0..20), Wrap=True)
item_2 = ListItem(List=flatten(L_2), Index=Slider(11, range=0..20), Wrap=True)
item_3 = ListItem(List=flatten(L_3), Index=Slider(8, range=0..20), Wrap=True)
item_4 = ListItem(List=flatten(L_4), Index=Slider(12, range=0..20), Wrap=True)
item_5 = ListItem(List=flatten(L_5), Index=Slider(7, range=0..20), Wrap=True)
item_6 = ListItem(List=flatten(L_6), Index=Slider(9, range=0..20), Wrap=True)
item_7 = ListItem(List=flatten(L_7), Index=Slider(13, range=0..20), Wrap=True)
item_8 = ListItem(List=flatten(L_8), Index=Slider(6, range=0..20), Wrap=True)
item_9 = ListItem(List=flatten(L_9), Index=Slider(0, range=0..20), Wrap=True)
item_10 = ListItem(List=flatten(L_10), Index=Slider(1, range=0..20), Wrap=True)
item_11 = ListItem(List=flatten(L_11), Index=Slider(20, range=0..20), Wrap=True)
item_12 = ListItem(List=flatten(L_12), Index=Slider(2, range=0..20), Wrap=True)
item_13 = ListItem(List=flatten(L_13), Index=Slider(19, range=0..20), Wrap=True)
item_14 = ListItem(List=flatten(L_14), Index=Slider(18, range=0..20), Wrap=True)
item_15 = ListItem(List=flatten(L_15), Index=Slider(3, range=0..20), Wrap=True)
item_16 = ListItem(List=flatten(L_16), Index=Slider(17, range=0..20), Wrap=True)
item_17 = ListItem(List=flatten(L_17), Index=Slider(13, range=0..20), Wrap=True)
item_18 = ListItem(List=flatten(L_18), Index=Slider(4, range=0..20), Wrap=True)
item_19 = ListItem(List=flatten(L_19), Index=Slider(16, range=0..20), Wrap=True)
item_20 = ListItem(List=flatten(L_20), Index=Slider(0, range=0..20), Wrap=True)
item_21 = ListItem(List=flatten(L_21), Index=Slider(15, range=0..20), Wrap=True)
item_22 = ListItem(List=flatten(L_22), Index=Slider(5, range=0..20), Wrap=True)
item_23 = ListItem(List=flatten(L_23), Index=Slider(14, range=0..20), Wrap=True)
item_24 = ListItem(List=flatten(L_24), Index=Slider(9, range=0..20), Wrap=True)
item_25 = ListItem(List=flatten(L_25), Index=Slider(10, range=0..20), Wrap=True)
i = ClusterOutput(item)
i_2 = ClusterOutput(item_2)
i_3 = ClusterOutput(item_3)
i_4 = ClusterOutput(item_4)
i_5 = ClusterOutput(item_5)
i_6 = ClusterOutput(item_6)
i_7 = ClusterOutput(item_7)
i_8 = ClusterOutput(item_8)
i_9 = ClusterOutput(item_9)
i_10 = ClusterOutput(item_10)
i_11 = ClusterOutput(item_11)
i_12 = ClusterOutput(item_12)
i_13 = ClusterOutput(item_13)
i_14 = ClusterOutput(item_14)
i_15 = ClusterOutput(item_15)
i_16 = ClusterOutput(item_16)
i_17 = ClusterOutput(item_17)
i_18 = ClusterOutput(item_18)
i_19 = ClusterOutput(item_19)
i_20 = ClusterOutput(item_20)
i_21 = ClusterOutput(item_21)
i_22 = ClusterOutput(item_22)
i_23 = ClusterOutput(item_23)
i_24 = ClusterOutput(item_24)
i_25 = ClusterOutput(item_25)
